# Dynamo graph Toposurface_Create_FromCADMesh(Revit2020).dyn (Dynamo 2.3.0.5885)

# group: Get geometry from linked cad file
selectImportedCADFile = DSModelElementSelection()  # 1 picked in the model; graph input
geometry = Element.Geometry(element=selectImportedCADFile)

# group: Filter meshes
string_from_object = FromObject(obj=geometry)
code_block = CodeBlock(elementtypename=string_from_object, element=geometry) { List.Clean(elementtypename=="Mesh"?element:null,false); }

# group: Get mesh vertices and face indecies
vertexPositions = Mesh.VertexPositions(mesh=code_block)
code_block_2 = CodeBlock(pnt=vertexPositions) { pnt[0]; }
faceIndices = Mesh.FaceIndices(mesh=code_block)
code_block_3 = CodeBlock(ind=faceIndices) { List.Transpose([ind[0].A,ind[0].B,ind[0].C]); }

# group: Create topography
python_script = Python(IN[0]=code_block_2, IN[1]=code_block_3)
# ---------- python_script.python (51 lines) ----------
import clr
clr.AddReference('ProtoGeometry')
from Autodesk.DesignScript.Geometry import *

# Import DocumentManager and TransactionManager
clr.AddReference("RevitServices")
import RevitServices
from RevitServices.Persistence import DocumentManager
from RevitServices.Transactions import TransactionManager
import System

clr.AddReference("RevitNodes")
import Revit
clr.ImportExtensions(Revit.GeometryConversion)


# Import RevitAPI
clr.AddReference("RevitAPI")
import Autodesk
from Autodesk.Revit.DB import *


doc = DocumentManager.Instance.CurrentDBDocument
uiapp = DocumentManager.Instance.CurrentUIApplication
app = uiapp.Application
#Import sys module
import sys
#Specify location path for IronPython install
pyt_path = r'C:\Program Files (x86)\IronPython 2.7\Lib'
sys.path.append(pyt_path)

clr.AddReference("System")
from System.Collections.Generic import List
from System.Collections.Generic import *
from collections import Counter

#The inputs to this node will be stored as a list in the IN variable.
dataEnteringNode = IN

#Get points and convert them to Revit XYZ points
pnts = [i.ToXyz() for i in IN[0]]
#Get indecies and create polymesh facets
facets = [PolymeshFacet(i[0],i[1],i[2]) for i in IN[1]]

#Start transaction
TransactionManager.Instance.EnsureInTransaction(doc)
#Create topography
newtopo=Autodesk.Revit.DB.Architecture.TopographySurface.Create(doc,pnts,facets)
#Close transaction
TransactionManager.Instance.TransactionTaskDone()
OUT =newtopo
# ----------------------------------------
